# Grasshopper definition 0609体块生成.gh (Grasshopper 1.0.7)
# plug-ins: BodyAnalytics, RhinoCodePluginGH

deconstruct_body = DeconstructBody()  # -> Id, UniqueObjectId, ActionState, Position, Velocity, PositionCovariance, Confidence, HeadPosition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
point = Point(deconstruct_body.BoundingBox)
list_item = ListItem(List=point, Index=Slider(4, range=0..10), Wrap=True)
cluster = Cluster()
cluster_2 = Cluster()
cluster_3 = Cluster()
cluster_4 = Cluster()
list_item_2 = ListItem(List=point, Index=Slider(6, range=0..10), Wrap=True)
vector_2pt = Vector2Pt(PointA=list_item, PointB=list_item_2, Unitize=False)  # -> Vector, Length

# ----
# 1
point_2 = Point(<point referenced from the Rhino model>)

# ----
# 2
point_3 = Point(<point referenced from the Rhino model>)

# ----
# 3
point_4 = Point(<point referenced from the Rhino model>)

# ----
# 8
point_5 = Point(<point referenced from the Rhino model>)

# ----
# 4
point_6 = Point(<point referenced from the Rhino model>)

# ----
# 6
point_7 = Point(<point referenced from the Rhino model>)

# ----
# 7
point_8 = Point(<point referenced from the Rhino model>)

# ----
# 5
point_9 = Point(<point referenced from the Rhino model>)

# ----
# 宽
vector_2pt_2 = Vector2Pt(PointA=point_8, PointB=point_5, Unitize=False)  # -> Vector, Length
division = Division(A=vector_2pt_2.Length, B=Slider(8, range=0..10))

# ----
# 长
vector_2pt_3 = Vector2Pt(PointA=point_9, PointB=point_8, Unitize=False)  # -> Vector, Length
division_2 = Division(A=vector_2pt_3.Length, B=Slider(8, range=0..10))

# ----
# 高
vector_2pt_4 = Vector2Pt(PointA=point_4, PointB=point_8, Unitize=False)  # -> Vector, Length
division_3 = Division(A=vector_2pt_4.Length, B=Slider(10, range=0..10))

number_slider = Slider(2, range=0..10)
vector_2pt_5 = Vector2Pt(PointA=point_8, PointB=point_2, Unitize=False)  # -> Vector, Length
_4point_surface = _4PointSurface(CornerA=point_3, CornerB=point_7, CornerC=point_5, CornerD=point_6)
_4point_surface_2 = _4PointSurface(CornerA=point_2, CornerB=point_9, CornerC=point_8, CornerD=point_4)
vector_2pt_6 = Vector2Pt(PointA=point_8, PointB=point_2, Unitize=False)  # -> Vector, Length
vector_2pt_7 = Vector2Pt(PointA=point_6, PointB=point_2, Unitize=False)  # -> Vector, Length
_4point_surface_3 = _4PointSurface(CornerA=point_2, CornerB=point_3, CornerC=point_6, CornerD=point_4)
division_4 = Division(A=vector_2pt_5.Vector, B=number_slider)
division_5 = Division(A=vector_2pt_6.Vector, B=number_slider)
number_slider_2 = Slider(10, range=0..10)
division_6 = Division(A=vector_2pt_7.Vector, B=Slider(2, range=0..10))
number_slider_3 = Slider(10, range=0..10)
move = Move(Geometry=_4point_surface_2, Motion=division_4)  # -> Geometry, Transform
move_2 = Move(Geometry=_4point_surface, Motion=division_5)  # -> Geometry, Transform
move_3 = Move(Geometry=_4point_surface_3, Motion=division_6)  # -> Geometry, Transform
rectangular = Rectangular(Plane=move.Geometry, SizeX=division_3, SizeY=division_2, ExtentX=number_slider_3, ExtentY=number_slider_3)  # -> Cells, Points
rectangular_2 = Rectangular(Plane=move_2.Geometry, SizeX=division_3, SizeY=division_2, ExtentX=number_slider_2, ExtentY=number_slider_2)  # -> Cells, Points
rectangular_3 = Rectangular(Plane=move_3.Geometry, SizeX=division, SizeY=division_2, ExtentX=Slider(8, range=0..10), ExtentY=Slider(10, range=0..10))  # -> Cells, Points
box_rectangle = BoxRectangle(Rectangle=rectangular.Cells, Height=Slider(0.01, range=0..0.1))
box_rectangle_2 = BoxRectangle(Rectangle=rectangular_2.Cells, Height=Slider(0.01, range=0..0.1))
box_rectangle_3 = BoxRectangle(Rectangle=rectangular_3.Cells, Height=Slider(0.01, range=0..0.1))

# ----
# 控制开敞度
number_slider_4 = Slider(53, range=0..100)

area = Area(Geometry=flatten(box_rectangle))  # -> Area, Centroid
# 以（5，4）为中心
panel = Panel("54")
area_2 = Area(Geometry=flatten(box_rectangle_2))  # -> Area, Centroid
# 以（5，4）为中心
panel_2 = Panel("54")
list_item_3 = ListItem(List=flatten(area.Centroid), Index=panel, Wrap=True)
list_item_4 = ListItem(List=flatten(area_2.Centroid), Index=panel_2, Wrap=True)
distance = Distance(PointA=flatten(area.Centroid), PointB=list_item_3)
distance_2 = Distance(PointA=flatten(area_2.Centroid), PointB=list_item_4)
sort_list = SortList(Keys=distance_2, ValuesValuesA=flatten(box_rectangle_2))  # -> Keys, ValuesValuesA
sort_list_2 = SortList(Keys=distance, ValuesValuesA=flatten(box_rectangle))  # -> Keys, ValuesValuesA
panel_3 = Panel(sort_list_2.ValuesValuesA)
area_3 = Area(Geometry=flatten(sort_list.ValuesValuesA))  # -> Area, Centroid
area_4 = Area(Geometry=flatten(sort_list_2.ValuesValuesA))  # -> Area, Centroid

# ----
# 旋转轴
list_item_5 = ListItem(List=flatten(sort_list_2.ValuesValuesA), Index=0, Wrap=True)
deconstruct_brep = DeconstructBrep(Brep=list_item_5)  # -> Faces, Edges, Vertices
list_item_6 = ListItem(List=deconstruct_brep.Vertices, Index=0, Wrap=True)
list_item_7 = ListItem(List=deconstruct_brep.Vertices, Index=Slider(3, range=0..10), Wrap=True)
vector_2pt_8 = Vector2Pt(PointA=list_item_6, PointB=list_item_7, Unitize=False)  # -> Vector, Length
line_sdl = LineSDL(Start=area_4.Centroid, Direction=vector_2pt_8.Vector, Length=1)

# ----
# 旋转轴
list_item_8 = ListItem(List=flatten(sort_list.ValuesValuesA), Index=0, Wrap=True)
deconstruct_brep_2 = DeconstructBrep(Brep=list_item_8)  # -> Faces, Edges, Vertices
list_item_9 = ListItem(List=deconstruct_brep_2.Vertices, Index=0, Wrap=True)
list_item_10 = ListItem(List=deconstruct_brep_2.Vertices, Index=Slider(3, range=0..10), Wrap=True)
vector_2pt_9 = Vector2Pt(PointA=list_item_9, PointB=list_item_10, Unitize=False)  # -> Vector, Length
line_sdl_2 = LineSDL(Start=area_3.Centroid, Direction=vector_2pt_9.Vector, Length=1)

script = Script(Y=number_slider_4)  # -> out, a
# ---------- script: Python ----------
import math

# 已知的 Y 值
Y_known = Y  # 示例值，你可以根据实际情况修改

# 定义目标函数
def equation(d):
    n = 100
    sum_sin = 0
    for k in range(n):
        sum_sin += math.sin((k * d * math.pi) / 180)
    return Y_known - (100 + sum_sin)

# 计算目标函数的导数
def derivative(d):
    n = 100
    sum_cos = 0
    for k in range(n):
        sum_cos += math.cos((k * d * math.pi) / 180) * (k * math.pi / 180)
    return -sum_cos

# 牛顿法求解
def newton_method(initial_guess, tol=1e-6, max_iter=1000):
    d = initial_guess
    for _ in range(max_iter):
        f_d = equation(d)
        f_prime_d = derivative(d)
        if abs(f_prime_d) < tol:
            raise ValueError("导数过小，牛顿法失效")
        d_new = d - f_d / f_prime_d
        if abs(d_new - d) < tol:
            return d_new
        d = d_new
    return d

# 初始猜测值
initial_guess = -1  # 假设公差 d 是负数

# 求解
d_solution = newton_method(initial_guess)
print(d_solution)
# ---------- end script ----------
larger_than = LargerThan(FirstNumber=number_slider_4, SecondNumber=34)  # -> LargerThan, OrEqualTo
smaller_than = SmallerThan(FirstNumber=number_slider_4, SecondNumber=35)  # -> SmallerThan, OrEqualTo
series = Series(Start=90, Step=-0.9090909091, Count=100)
series_2 = Series(Start=90, Step=script.out, Count=100)
division_7 = Division(A=series, B=180)
cull_pattern = CullPattern(List=series_2, CullPattern=larger_than.LargerThan)
pi = Pi(Factor=division_7)
cosine = Cosine(Value=pi)
subtraction = Subtraction(A=1, B=cosine)
division_8 = Division(A=cull_pattern, B=180)
mass_addition = MassAddition(Input=subtraction)  # -> Result, PartialResults
division_9 = Division(A=number_slider_4, B=mass_addition.Result)
multiplication = Multiplication(A=0.909091, B=division_9)
series_3 = Series(Start=0, Step=multiplication, Count=100)
pi_2 = Pi(Factor=division_8)

panel_4 = Panel(script.out)
rev = ReverseList(List=series_3)

cull_pattern_2 = CullPattern(List=rev, CullPattern=smaller_than.SmallerThan)
division_10 = Division(A=cull_pattern_2, B=180)
pi_3 = Pi(Factor=division_10)

# ----
# 角度
smaller_than_2 = SmallerThan(FirstNumber=number_slider_4, SecondNumber=35)  # -> SmallerThan, OrEqualTo
multiplication_2 = Multiplication(A=pi_3, B=-1)
cull_pattern_3 = CullPattern(List=multiplication_2, CullPattern=smaller_than_2.SmallerThan)
multiplication_3 = Multiplication(A=pi_2, B=-1)

panel_5 = Panel(pi_3)
# 旋转
rotate_axis = RotateAxis(Geometry=flatten(sort_list_2.ValuesValuesA), Angle=[pi_3, pi_2], Axis=line_sdl)  # -> Geometry, Transform
rotate_axis_2 = RotateAxis(Geometry=flatten(sort_list.ValuesValuesA), Angle=[multiplication_3, cull_pattern_3], Axis=line_sdl_2)  # -> Geometry, Transform

# ==== cluster Cluster
