# Grasshopper definition Test-现场测试所用.gh (Grasshopper 1.0.7)
# plug-ins: BodyAnalytics

path = FilePath("E:\研究生\研1\15 设计课\3.21_1_perspective.csv")
extract = KeypointsExtract(FilePath=path)  # -> Status, FileKeypoints
kp17 = KeypointsParser17(FileKeypoints=extract.FileKeypoints)  # -> Hip, RHip, RKnee, RFoot, LHip, LKnee, LFoot, Spine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

path_2 = FilePath("E:\研究生\研1\15 设计课\3.21_1_perspective.csv")
analyze = StridesAnalyze(FilePath=path_2, ZThreshold=Slider(0.058, range=0..0.1), FrameIndex=Slider(200, range=0..1000), FrameInterval=1)  # -> Status, Strides, StrideIndices, LeftZ, RightZ, PoseLines, DoubleSupportFrames, SingleFrameLines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

# ----
# 这颗电池负责连接服务器
boolean_toggle = BooleanToggle(True)

# ----
# 这颗电池负责按一定刷新率激活
# 每次激活将最新数据传递给后面的gh电池。
number_slider = Slider(250, range=100..5000)
# 输出一个自定义类型（body）
# 自带一个显示
receive = Receive(Interval=number_slider)  # -> Timestamp, Body, PyMessage, RCSLocation

serverconnector = ServerConnector(Host="127.0.0.1", Port="8899", Run=boolean_toggle)
plane = Plane(receive.RCSLocation)
panel = Panel(receive.Timestamp)
body = Body(receive.Body)
panel_2 = Panel(receive.PyMessage)
panel_3 = Panel(receive.Body)
list_item = ListItem(List=body, Index=0, Wrap=True)
center_box = CenterBox(Base=plane, X="0.05", Y="0.05", Z="0.05")
# 将Body对象解构
deconstruct_body = DeconstructBody(Body=list_item)  # -> Id, UniqueObjectId, ActionState, Position, Velocity, PositionCovariance, Confidence, HeadPosition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
point = Point(deconstruct_body.BoundingBox)
panel_4 = Panel(deconstruct_body.Keypoints)
list_item_2 = ListItem(List=point, Index=6, Wrap=True)
list_item_3 = ListItem(List=point, Index=4, Wrap=True)
item = ListItem(List=deconstruct_body.Dimensions, Index=Slider(0, range=0..100), Wrap=True)
box_2pt = Box2Pt(PointA=list_item_3, PointB=list_item_2, Plane=PlaneXY(0, 0, 0))
pt = ConstructPoint(XCoordinate=0, YCoordinate=0, ZCoordinate=0)
mesh_colours = MeshColours(Mesh=box_2pt, Colours=ColourSwatch(SwatchColor=RGB(252, 134, 134)))
mesh_colours_2 = MeshColours(Mesh=center_box, Colours=ColourSwatch(SwatchColor=RGB(72, 255, 0)))
mesh_join = MeshJoin(Meshes=flatten([mesh_colours_2, mesh_colours]))
brep = Brep(<brep referenced from the Rhino model>)
mesh = Mesh(brep)
# 负责输出数据给Server
send = Send(Timestamp=receive.Timestamp, Message="我是GH", Meshes=[mesh_join, mesh])
