# Grasshopper definition 体块生成（中心旋转版）0609.gh (Grasshopper 1.0.7)
# plug-ins: MR-HSI

deconstruct_body = DeconstructBody()  # -> Id, UniqueObjectId, ActionState, Position, Velocity, PositionCovariance, Confidence, HeadPosition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
point = Point(deconstruct_body.BoundingBox)
list_item = ListItem(List=point, Index=Slider(4, range=0..10), Wrap=True)
cluster = Cluster()
cluster_2 = Cluster()
cluster_3 = Cluster()
cluster_4 = Cluster()
cluster_5 = Cluster()
list_item_2 = ListItem(List=point, Index=Slider(6, range=0..10), Wrap=True)
vector_2pt = Vector2Pt(PointA=list_item, PointB=list_item_2, Unitize=False)  # -> Vector, Length

# ----
# 1
point_2 = Point(<point referenced from the Rhino model>)

# ----
# 2
point_3 = Point(<point referenced from the Rhino model>)

# ----
# 8
point_4 = Point(<point referenced from the Rhino model>)

# ----
# 3
point_5 = Point(<point referenced from the Rhino model>)

# ----
# 4
point_6 = Point(<point referenced from the Rhino model>)

# ----
# 6
point_7 = Point(<point referenced from the Rhino model>)

# ----
# 7
point_8 = Point(<point referenced from the Rhino model>)

# ----
# 5
point_9 = Point(<point referenced from the Rhino model>)

# ----
# 宽
vector_2pt_2 = Vector2Pt(PointA=point_8, PointB=point_4, Unitize=False)  # -> Vector, Length
division = Division(A=vector_2pt_2.Length, B=Slider(8, range=0..10))

# ----
# 长
vector_2pt_3 = Vector2Pt(PointA=point_9, PointB=point_8, Unitize=False)  # -> Vector, Length
division_2 = Division(A=vector_2pt_3.Length, B=Slider(8, range=0..10))

panel = Panel(vector_2pt_3.Length)

# ----
# 高
vector_2pt_4 = Vector2Pt(PointA=point_5, PointB=point_8, Unitize=False)  # -> Vector, Length
division_3 = Division(A=vector_2pt_4.Length, B=Slider(10, range=0..10))

vector_2pt_5 = Vector2Pt(PointA=point_8, PointB=point_2, Unitize=False)  # -> Vector, Length
division_4 = Division(A=vector_2pt_5.Vector, B=Slider(2, range=0..10))
_4point_surface = _4PointSurface(CornerA=point_2, CornerB=point_9, CornerC=point_8, CornerD=point_5)
number_slider = Slider(10, range=0..10)
move = Move(Geometry=_4point_surface, Motion=division_4)  # -> Geometry, Transform
rectangular = Rectangular(Plane=move.Geometry, SizeX=division_3, SizeY=division_2, ExtentX=number_slider, ExtentY=number_slider)  # -> Cells, Points
box_rectangle = BoxRectangle(Rectangle=rectangular.Cells, Height=Slider(0.01, range=0..0.1))
area = Area(Geometry=box_rectangle)  # -> Area, Centroid
list_item_3 = ListItem(List=flatten(area.Centroid), Index="54", Wrap=True)
vector_2pt_6 = Vector2Pt(PointA=flatten(area.Centroid), PointB=list_item_3, Unitize=False)  # -> Vector, Length
list_item_4 = ListItem(List=flatten(vector_2pt_6.Length), Index=0, Wrap=True)
panel_2 = Panel(list_item_4)

# ==== cluster Cluster
