# Grasshopper definition 虚拟办公仓.gh (Grasshopper 1.0.7)
# plug-ins: BodyAnalytics, RhinoCodePluginGH

# ----
# 这颗电池负责按一定刷新率激活
# 每次激活将最新数据传递给后面的gh电池。
number_slider = Slider(250, range=100..5000)
receive = Receive(Interval=number_slider)  # -> Timestamp, Body, PyMessage, RCSLocation

# ----
# 这颗电池负责连接服务器
boolean_toggle = BooleanToggle(True)
serverconnector = ServerConnector(Host="127.0.0.1", Port="8899", Run=boolean_toggle)

panel = Panel(receive.Timestamp)
# 输出一个自定义类型（body）
# 自带一个显示
body = Body(receive.Body)
panel_2 = Panel(receive.PyMessage)
list_item = ListItem(List=body, Index=0, Wrap=True)
# 将Body对象解构
deconstruct_body = DeconstructBody(Body=list_item)  # -> Id, UniqueObjectId, ActionState, Position, Velocity, PositionCovariance, Confidence, HeadPosition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
panel_3 = Panel(deconstruct_body.Keypoints)
point = Point(deconstruct_body.BoundingBox)

# ----
# 要改
list_item_2 = ListItem(List=point, Index=6, Wrap=True)
list_item_3 = ListItem(List=point, Index=5, Wrap=True)
list_item_4 = ListItem(List=point, Index=4, Wrap=True)

骨盆点 = ListItem(List=deconstruct_body.Keypoints, Index=0, Wrap=True)
躯干点 = ListItem(List=deconstruct_body.Keypoints, Index=1, Wrap=True)
右跨 = ListItem(List=deconstruct_body.Keypoints, Index=22, Wrap=True)
左跨 = ListItem(List=deconstruct_body.Keypoints, Index=18, Wrap=True)
右膝 = ListItem(List=deconstruct_body.Keypoints, Index=23, Wrap=True)
左膝 = ListItem(List=deconstruct_body.Keypoints, Index=19, Wrap=True)
地面平面 = Plane3Pt(PointA=list_item_4, PointB=list_item_3, PointC=list_item_2)
右膝_2 = ListItem(List=deconstruct_body.Keypoints, Index=23, Wrap=True)
左膝_2 = ListItem(List=deconstruct_body.Keypoints, Index=19, Wrap=True)
右踝 = ListItem(List=deconstruct_body.Keypoints, Index=24, Wrap=True)
左踝 = ListItem(List=deconstruct_body.Keypoints, Index=20, Wrap=True)

# ----
# 专注度计算
左眼 = ListItem(List=deconstruct_body.Keypoints, Index=28, Wrap=True)
右眼 = ListItem(List=deconstruct_body.Keypoints, Index=30, Wrap=True)
鼻子 = ListItem(List=deconstruct_body.Keypoints, Index=27, Wrap=True)
dataqueue = DataQueue(Data=左眼, RecordCount=720)  # -> OutputData, OldestPath, NewestPath
dataqueue_2 = DataQueue(Data=鼻子, RecordCount=720)  # -> OutputData, OldestPath, NewestPath
dataqueue_3 = DataQueue(Data=右眼, RecordCount=720)  # -> OutputData, OldestPath, NewestPath
list_length = ListLength(List=flatten(dataqueue.OutputData))
list_length_2 = ListLength(List=flatten(dataqueue_2.OutputData))
list_length_3 = ListLength(List=flatten(dataqueue_3.OutputData))
subtraction = Subtraction(A=list_length, _10=10)
subtraction_2 = Subtraction(A=list_length_2, _10=10)
subtraction_3 = Subtraction(A=list_length_3, _10=10)
list_item_5 = ListItem(List=flatten(dataqueue.OutputData), Index=list_length, Wrap=True)
list_item_6 = ListItem(List=flatten(dataqueue.OutputData), Index=subtraction, Wrap=True)
list_item_7 = ListItem(List=flatten(dataqueue_2.OutputData), Index=list_length_2, Wrap=True)
list_item_8 = ListItem(List=flatten(dataqueue_2.OutputData), Index=subtraction_2, Wrap=True)
list_item_9 = ListItem(List=flatten(dataqueue_3.OutputData), Index=list_length_3, Wrap=True)
list_item_10 = ListItem(List=flatten(dataqueue_3.OutputData), Index=subtraction_3, Wrap=True)
plane_3pt = Plane3Pt(PointA=list_item_9, PointB=list_item_5, PointC=list_item_7)
plane_3pt_2 = Plane3Pt(PointA=list_item_10, PointB=list_item_6, PointC=list_item_8)
deconstruct_plane = DeconstructPlane(Plane=plane_3pt)  # -> Origin, XAxis, YAxis, ZAxis
deconstruct_plane_2 = DeconstructPlane(Plane=plane_3pt_2)  # -> Origin, XAxis, YAxis, ZAxis
pi = Pi(Factor=1)
angle = Angle(VectorA=deconstruct_plane.ZAxis, VectorB=deconstruct_plane_2.ZAxis)  # -> Angle, Reflex
division = Division(A=pi, B=0.05555555556)
larger_than = LargerThan(FirstNumber=angle.Angle, SecondNumber=division)  # -> LargerThan, OrEqualTo
dispatch = Dispatch(List=angle.Angle, DispatchPattern=larger_than.LargerThan)  # -> ListA, ListB
list_length_4 = ListLength(List=dispatch.ListA)
multiplication = Multiplication(A=list_length_4, _00633=0.0633)
subtraction_4 = Subtraction(_08185=0.8185, B=multiplication)
multiplication_2 = Multiplication(A=subtraction_4, _100=100)

上身向量 = Vector2Pt(PointA=骨盆点, PointB=躯干点, Unitize=False)  # -> Vector, Length
右大腿向量 = Vector2Pt(PointA=右跨, PointB=右膝, Unitize=False)  # -> Vector, Length
左大腿向量 = Vector2Pt(PointA=左跨, PointB=左膝, Unitize=False)  # -> Vector, Length
右小腿向量 = Vector2Pt(PointA=右膝_2, PointB=右踝, Unitize=False)  # -> Vector, Length
deconstruct_plane_3 = DeconstructPlane(Plane=地面平面)  # -> Origin, XAxis, YAxis, ZAxis
左小腿向量 = Vector2Pt(PointA=左膝_2, PointB=左踝, Unitize=False)  # -> Vector, Length
pi_2 = Pi(Factor=1)
addition = Addition(A=右大腿向量.Vector, B=左大腿向量.Vector)
angle_2 = Angle(VectorA=deconstruct_plane_3.ZAxis, VectorB=上身向量.Vector)  # -> Angle, Reflex
addition_2 = Addition(A=右小腿向量.Vector, B=左小腿向量.Vector)
division_2 = Division(A=addition, B=2)
division_3 = Division(A=pi_2, B=2)
division_4 = Division(A=addition_2, B=2)
大腿平均向量 = Vector(division_2)
subtraction_5 = Subtraction(Pi2=division_3, B=angle_2.Angle)
躯干夹角 = Angle(VectorA=上身向量.Vector, VectorB=大腿平均向量)  # -> Angle, Reflex
小腿平均向量 = Vector(division_4)

# ----
# 舒适度计算公式 cos( 3/2 * ( pi - x ) ) + 0.5
pi_3 = Pi(Factor=1)
subtraction_6 = Subtraction(A=pi_3, B=躯干夹角.Angle)
multiplication_3 = Multiplication(A=subtraction_6, _32=1.5)
addition_3 = Addition(A=multiplication_3, _05=0.5)

大腿与小腿夹角 = Angle(VectorA=大腿平均向量, VectorB=小腿平均向量)  # -> Angle, Reflex

# ----
# 集中度计算公式   (cosx + 1)/2 + 0.5
cosine = Cosine(Value=subtraction_5)
addition_4 = Addition(A=cosine, B=1)
division_5 = Division(A=addition_4, B=2)
addition_5 = Addition(A=division_5, _05=0.5)

panel_4 = Panel(躯干夹角.Angle)

# ----
# 疲劳度计算公式 0.5 + （| sin( x1 - 90 ) | + | sin( x2 - 90) |) * 2
pi_4 = Pi(Factor=1)
pi_5 = Pi(Factor=1)
division_6 = Division(A=pi_4, B=2)
division_7 = Division(A=pi_5, B=2)
subtraction_7 = Subtraction(A=躯干夹角.Angle, B=division_6)
subtraction_8 = Subtraction(A=大腿与小腿夹角.Angle, B=division_7)
sine = Sine(Value=subtraction_7)
sine_2 = Sine(Value=subtraction_8)
absolute = Absolute(Value=sine_2)
absolute_2 = Absolute(Value=sine)
addition_6 = Addition(A=absolute_2, B=absolute)
multiplication_4 = Multiplication(A=addition_6, _12=1.2)
addition_7 = Addition(A=multiplication_4, _05=0.5)

script = Script()  # -> out, O0_read
# ---------- script: Python ----------
import csv

# 这里写你刚才保存的CSV文件完整路径
ReadPath = r"D:\文件\MR\交互结果\O_result.csv"  # 改成你自己的路径

O0_read = None

try:
    with open(ReadPath, mode='r') as file:
        reader = csv.reader(file)
        header = next(reader)  # 读取表头，跳过
        row = next(reader)     # 读取数据行
        O0_read = float(row[0])  # 转成浮点数
    Msg = "读取成功"
except Exception as e:
    Msg = "读取失败: " + str(e)

# 输出变量
print(O0_read)
O0_read = float(O0_read)
# ---------- end script ----------
multiplication_5 = Multiplication(A=addition_5, B=multiplication_2)
number = Number(script.O0_read)
# 内置开放度
script_2 = Script(F_target=multiplication_5, O0=number)  # -> out, a
# ---------- script_2: Python ----------
import csv

def F(O):
    return -0.000038*O**4 + 0.007576*O**3 - 0.463138*O**2 + 8.205234*O + 56.921186

def f(O, F_target):
    return F(O) - F_target

def bisection(f, F_target, low, high, tol=1e-6):
    while high - low > tol:
        mid = (low + high)/2
        if f(low, F_target)*f(mid, F_target) <= 0:
            high = mid
        else:
            low = mid
    return (low + high)/2

def find_roots(f, F_target, interval, steps=1000, tol=1e-6):
    a, b = interval
    roots = []
    xs = [a + (b - a)*i/steps for i in range(steps+1)]
    fs = [f(x, F_target) for x in xs]

    for i in range(steps):
        if fs[i]*fs[i+1] <= 0:
            root = bisection(f, F_target, xs[i], xs[i+1], tol)
            if not any(abs(root - r) < tol for r in roots):  # 去重
                roots.append(root)
    return roots

# 输入
# F_target 和 O0 从GH传入

SavePath = r"D:\文件\MR\交互结果\O_result.csv"  # 修改为你电脑路径

minF = min(F(x) for x in range(0, 101))
maxF = max(F(x) for x in range(0, 101))

O = None
if minF <= F_target <= maxF:
    roots = find_roots(f, F_target, (0, 100))
    if roots:
        O = min(roots, key=lambda x: abs(x - O0))

# 写入CSV，只写一列‘O’
if O is not None:
    try:
        with open(SavePath, mode='w', newline='') as file:
            writer = csv.writer(file)
            writer.writerow(['O'])
            writer.writerow([O])
        Msg = "保存成功"
    except Exception as e:
        Msg = "保存失败：" + str(e)
else:
    Msg = "无解或目标值超出函数范围"

print(O)
# ---------- end script_2 ----------
multiplication_6 = Multiplication(内置开放度=script_2.out, 疲劳度系数=addition_7)
plane = Plane(receive.RCSLocation)
pt = Point(deconstruct_body.BoundingBox)
item = ListItem(List=pt, Index=6, Wrap=True)
item_2 = ListItem(List=pt, Index=7, Wrap=True)
item_3 = ListItem(List=pt, Index=4, Wrap=True)
item_4 = ListItem(List=pt, Index=3, Wrap=True)

# ----
# 可以尝试替换成PCSLocation
plane_surface = PlaneSurface(Plane=PlaneXY(0, 0, 0), XSize=Domain(-1, 1), YSize=Domain(-1, 1))

division_8 = Division(A=multiplication_6, _100=100)
注意力公式 = Panel(division_8)

# ----
# 开敞度
number_slider_2 = Slider(0.3, range=0..1)

左眼_2 = ListItem(List=deconstruct_body.Keypoints, Index=28, Wrap=True)

# ----
# 替换成头部点
point_2 = Point(左眼_2)

center_box = CenterBox(Base=plane, X="0.05", Y="0.05", Z="0.05")
deplane = DeconstructPlane(Plane=plane)  # -> Origin, XAxis, YAxis, ZAxis
vec = VectorXYZ(XComponent=0, YComponent=0, ZComponent=1)  # -> Vector, Length
mesh_colours = MeshColours(Mesh=center_box, Colours=ColourSwatch(SwatchColor=RGB(72, 255, 0)))
line = LineSDL(Start=deplane.Origin, Direction=vec.Vector, Length=1)

point_3 = Point(item_4)
point_4 = Point(item_3)
point_5 = Point(item)
point_6 = Point(item_2)
宽 = Vector2Pt(PointA=point_6, PointB=point_5, Unitize=False)  # -> Vector, Length
高 = Vector2Pt(PointA=point_3, PointB=point_6, Unitize=False)  # -> Vector, Length
长 = Vector2Pt(PointA=point_4, PointB=point_6, Unitize=False)  # -> Vector, Length
宽边块数 = Division(A=宽.Length, _01=0.1)
高块数 = Division(A=高.Length, _01=0.1)
长边块数 = Division(A=长.Length, _02=0.1)
integer = Integer(长边块数)
integer_2 = Integer(宽边块数)
integer_3 = Integer(高块数)
deconstruct_plane_4 = DeconstructPlane(Plane=receive.RCSLocation)  # -> Origin, XAxis, YAxis, ZAxis
增加三块 = Addition(A=integer, B=5)
增加三块_2 = Addition(A=integer_2, B=4)
增加三块_3 = Addition(A=integer_3, B=5)
point_7 = Point(deconstruct_plane_4.Origin)
number_slider_3 = Slider(0.1, range=0..1)
xz_plane = XZPlane(Origin=point_7)
panel_5 = Panel(高.Length)
总矩形数 = Multiplication(A=增加三块, B=增加三块_3)
rectangular = Rectangular(Plane=xz_plane, SizeX=number_slider_3, SizeY=number_slider_3, ExtentX=增加三块, ExtentY=增加三块_3)  # -> Cells, Points
box_rectangle = BoxRectangle(Rectangle=flatten(rectangular.Cells), Height=Domain(0, 0.01))
xy_plane = XYPlane(Origin=point_7)
area = Area(Geometry=flatten(box_rectangle))  # -> Area, Centroid
角度数 = Division(_90=90, B=总矩形数)
rectangle = Rectangle(Plane=xy_plane, XSize=Domain(-0.02, 0), YSize=Domain(-0.1, 0.1), Radius=0)  # -> Rectangle, Length
矩形中点与头部的距离 = Distance(PointA=flatten(area.Centroid), PointB=point_2)
根据距离重新排序 = SortList(Keys=矩形中点与头部的距离, ValuesValuesA=flatten(box_rectangle))  # -> Keys, ValuesValuesA
multiplication_7 = Multiplication(A=增加三块_2, _01=0.1)
vector_xyz = VectorXYZ(XComponent=0, YComponent=multiplication_7, ZComponent=0)  # -> Vector, Length
move = Move(Geometry=flatten(根据距离重新排序.ValuesValuesA), Motion=vector_xyz.Vector)  # -> Geometry, Transform
smaller_than = SmallerThan(FirstNumber=division_8, SecondNumber=0.51)  # -> SmallerThan, OrEqualTo
larger_than_2 = LargerThan(FirstNumber=division_8, SecondNumber=0.5)  # -> LargerThan, OrEqualTo

panel_6 = Panel(增加三块)

# ----
# 旋转轴
list_item_11 = ListItem(List=flatten(根据距离重新排序.ValuesValuesA), Index=0, Wrap=True)
area_2 = Area(Geometry=根据距离重新排序.ValuesValuesA)  # -> Area, Centroid
deconstruct_brep = DeconstructBrep(Brep=list_item_11)  # -> Faces, Edges, Vertices
矩形第一点 = ListItem(List=deconstruct_brep.Vertices, Index=0, Wrap=True)
矩形第二点 = ListItem(List=deconstruct_brep.Vertices, Index=1, Wrap=True)
vector_2pt = Vector2Pt(PointA=矩形第一点, PointB=矩形第二点, Unitize=False)  # -> Vector, Length
line_sdl = LineSDL(Start=area_2.Centroid, Direction=vector_2pt.Vector, Length=0.5)

multiplication_8 = Multiplication(A=division_8, B=2)
multiplication_9 = Multiplication(A=角度数, B=multiplication_8)
smaller_than_2 = SmallerThan(FirstNumber=division_8, SecondNumber=0.51)  # -> SmallerThan, OrEqualTo
series = Series(Start=0, Step=multiplication_9, Count=总矩形数)
division_9 = Division(A=series, _180=180)
pi_6 = Pi(Factor=division_9)
reverse_list = ReverseList(List=pi_6)
cull_pattern = CullPattern(List=reverse_list, CullPattern=smaller_than_2.SmallerThan)

angle_3 = Angle(VectorA=deplane.XAxis, VectorB=vector_2pt.Vector)  # -> Angle, Reflex

xy_plane_2 = XYPlane(Origin=point_7)
multiplication_10 = Multiplication(A=增加三块_2, _01=0.1)
multiplication_11 = Multiplication(A=增加三块_3, _01=0.1)
multiplication_12 = Multiplication(A=增加三块, _01=0.1)
vector_xyz_2 = VectorXYZ(XComponent=-0.1, YComponent=-0.1, ZComponent=multiplication_11)  # -> Vector, Length

addition_8 = Addition(A=multiplication_10, _02=0.2)
addition_9 = Addition(A=multiplication_12, _01=0.1)
vector_xyz_3 = VectorXYZ(XComponent=multiplication_12, YComponent=0, ZComponent=0)  # -> Vector, Length
box_rectangle_2 = BoxRectangle(Rectangle=rectangle.Rectangle, Height=multiplication_11)
vector_xyz_4 = VectorXYZ(XComponent=0, YComponent=multiplication_10, ZComponent=0)  # -> Vector, Length
move_2 = Move(Geometry=box_rectangle_2, Motion=vector_xyz_3.Vector)  # -> Geometry, Transform
move_3 = Move(Geometry=[box_rectangle_2, move_2.Geometry], Motion=vector_xyz_4.Vector)  # -> Geometry, Transform
move_4 = Move(Geometry=flatten(line_sdl), Motion=vector_xyz.Vector)  # -> Geometry, Transform
multiplication_13 = Multiplication(A=reverse_list, _1=-1)
cull_pattern_2 = CullPattern(List=multiplication_13, CullPattern=smaller_than.SmallerThan)

rectangle_2 = Rectangle(Plane=xy_plane_2, XSize=addition_9, YSize=addition_8, Radius=0)  # -> Rectangle, Length
box_rectangle_3 = BoxRectangle(Rectangle=rectangle_2.Rectangle, Height=Domain(0, 0.01))
move_5 = Move(Geometry=box_rectangle_3, Motion=vector_xyz_2.Vector)  # -> Geometry, Transform

multiplication_14 = Multiplication(A=总矩形数, B=总矩形数, C=8)
multiplication_15 = Multiplication(A=总矩形数, _4=-4)
multiplication_16 = Multiplication(A=总矩形数, B=总矩形数, C=division_8, _8=-8)
addition_10 = Addition(A=1, B=multiplication_16, C=multiplication_15, D=multiplication_14)
square_root = SquareRoot(Value=addition_10)
addition_11 = Addition(A=1, B=square_root)
division_10 = Division(A=addition_11, B=2)
相加份数 = Subtraction(A=总矩形数, B=division_10)
series_2 = Series(Start=相加份数, Step=角度数, Count=总矩形数)
larger_than_3 = LargerThan(FirstNumber=division_8, SecondNumber=0.5)  # -> LargerThan, OrEqualTo

# ----
# 替换大于90度的角
smaller_than_3 = SmallerThan(FirstNumber=series_2, SecondNumber=90)  # -> SmallerThan, OrEqualTo
cull_pattern_3 = CullPattern(List=series_2, CullPattern=smaller_than_3.SmallerThan)
list_length_5 = ListLength(List=cull_pattern_3)
subtraction_9 = Subtraction(A=总矩形数, B=list_length_5)
series_3 = Series(Start=list_length_5, Step=1, Count=subtraction_9)
replace_items = ReplaceItems(List=series_2, Item=90, Indices=series_3, Wrap=False)

reverse_list_2 = ReverseList(List=replace_items)
cull_pattern_4 = CullPattern(List=reverse_list_2, CullPattern=larger_than_3.OrEqualTo)
division_11 = Division(A=cull_pattern_4, _180=180)
pi_7 = Pi(Factor=division_11)

mesh_brep = MeshBrep(
    Brep=[move_2.Geometry, move_3.Geometry, box_rectangle_2, move_5.Geometry],
    Settings={GridMaxCount=0, GridMinCount=16, JaggedSeams=False, MaxEdgeLength=0, MinEdgeLength=0.0001, MinTolerance=0, Refine=True, RefineAngle=0, RelativeTolerance=0.65, SimplePlanes=True, Tolerance=0})
multiplication_17 = Multiplication(A=pi_7, _1=-1)
cull_pattern_5 = CullPattern(List=multiplication_17, CullPattern=larger_than_2.LargerThan)
rotate_axis = RotateAxis(Geometry=move.Geometry, Angle=[cull_pattern_5, cull_pattern_2], Axis=move_4.Geometry)  # -> Geometry, Transform
rotate_axis_2 = RotateAxis(Geometry=flatten(根据距离重新排序.ValuesValuesA), Angle=[pi_7, cull_pattern], Axis=line_sdl)  # -> Geometry, Transform
mesh_brep_2 = MeshBrep(
    Brep=flatten([rotate_axis.Geometry, rotate_axis_2.Geometry]),
    Settings={GridMaxCount=0, GridMinCount=16, JaggedSeams=False, MaxEdgeLength=0, MinEdgeLength=0.0001, MinTolerance=0, Refine=True, RefineAngle=0, RelativeTolerance=0.65, SimplePlanes=True, Tolerance=0})

# ----
# 最终呈现
colour_swatch = ColourSwatch(SwatchColor=RGB(222, 222, 222))
mesh_colours_2 = MeshColours(Mesh=mesh_brep, Colours=colour_swatch)
mesh_colours_3 = MeshColours(Mesh=mesh_brep_2, Colours=ColourSwatch(SwatchColor=RGB(255, 255, 255)))

rotax = RotateAxis(Geometry=[mesh_colours_2, mesh_colours_3], Angle=angle_3.Angle, Axis=line)  # -> Geometry, Transform
mjoin = MeshJoin(Meshes=flatten([rotax.Geometry, mesh_colours]))

# ----
# 负责输出数据给Server
send = Send(Timestamp=receive.Timestamp, Message="我是GH", Mesh=mjoin)
